vi "Root1.gvi"   [LabVIEW NXG 2.1.0]
panel controls:
  "input 0": f64
  "input 1_2": f64
panel indicators:
  "Output": i32
diagram:
  Square(x=$"input 0") -> w1
  Is Greater Than 0(x=$"input 1_2") -> w2
  case (w2) {
    frame False, Default {
      # TODO:Fill in code
      w3 = default
    }
    frame True {
      To Byte Integer(number=w1) -> w4
      In Range And Coerce(lower limit=0, upper limit=100, x=w4) -> (coerced(x)=w5)
      for (N = w5) (iteration -> i1) {
        append i1 to w6
      }
      Add Array Elements(numeric array=w6) -> (sum=w3)
    }
  }
  Increment(x=w3) -> w7
  Square(x=w7) -> w8
  $Output <- w8
